# Grasshopper definition unicamTools2.0.gh (Grasshopper 1.0.7)
# plug-ins: Hops, MetaHopper

relative_path = RelativePath(Path=".\weather")
location_worksheet_name = Panel("locations")
weather_worksheet_name = Panel("weather_data_1hr")
new_workbook = Panel("DBresults")
run = BooleanToggle(True)
document_info = DocumentInfo(AutoUpdate=invert(False), Recursive=invert(False))  # -> DocumentName, DocumentFilePath, Components, Params, _3rdPartyAssemblies
format = Format(Format="{0}{1}\{2}.gh", Culture=127, Data0=relative_path, Data1="white", Data2="make directory paths")
hops = Hops(
    _Path=format,
    _Enabled=run,
    GhFilePath=relative_path,
    LocationWorksheetName=location_worksheet_name,
    WeatherWorksheetName=weather_worksheet_name,
    DBWorkbook=new_workbook,
    CacheResultsInMemory=False,
    CacheSolveResults=False,
    RemoteDefinitionLocation="C:\Users\ionon\OneDrive - Università di Camerino\Documents\GitHub\unicamTools\weatherwhite\make directory paths.gh",
    RemoteSolveVersion=(0, 1, 0),
    ShowInput_Enabled=True,
    ShowInput_Path=True,
    SynchronousSolve=False)  # -> LocationPath, Weather_data_1hrPath, DBWorkbook
format_2 = Format(Format="{0}{1}\{2}.gh", Culture=127, Data0=relative_path, Data1="white", Data2="check directory consistence py")
hops_2 = Hops(
    _Path=format_2,
    _Enabled=run,
    LocationPath=hops.LocationPath,
    Weather_data_1hrPath=hops.Weather_data_1hrPath,
    CacheResultsInMemory=False,
    CacheSolveResults=False,
    RemoteDefinitionLocation="C:\Users\ionon\OneDrive - Università di Camerino\Documents\GitHub\unicamTools\weatherwhite\check directory consistence py.gh",
    RemoteSolveVersion=(0, 1, 0),
    ShowInput_Enabled=True,
    ShowInput_Path=True,
    SynchronousSolve=True)  # -> Message, Check
format_3 = Format(Format="{0}{1}\{2}.gh", Culture=127, Data0=relative_path, Data1="white", Data2="Get cities from coordinates")
hops_3 = Hops(
    _Path=format_3,
    Run=hops_2.Check,
    LocationPath=hops.LocationPath,
    CacheResultsInMemory=False,
    CacheSolveResults=False,
    RemoteDefinitionLocation="C:\Users\ionon\OneDrive - Università di Camerino\Documents\GitHub\unicamTools\weatherwhite\Get cities from coordinates.gh",
    RemoteSolveVersion=(0, 1, 0),
    ShowInput_Enabled=False,
    ShowInput_Path=True,
    SynchronousSolve=True)  # -> Cities, Loc_id
format_4 = Format(Format="{0}{1}\{2}.gh", Culture=127, Data0=relative_path, Data1="white", Data2="selectet Variable and remove 29-02")
panel = Panel(hops.Weather_data_1hrPath)
hops_4 = Hops(
    _Path=format_4,
    Run=hops_2.Check,
    Weather_data_1hrPath=hops.Weather_data_1hrPath,
    Cities=hops_3.Cities,
    Loc_id=hops_3.Loc_id,
    CacheResultsInMemory=False,
    CacheSolveResults=False,
    RemoteDefinitionLocation="C:\Users\ionon\OneDrive - Università di Camerino\Documents\GitHub\unicamTools\weatherwhite\selectet Variable and remove 29-02.gh",
    RemoteSolveVersion=(0, 1, 0),
    ShowInput_Enabled=False,
    ShowInput_Path=True,
    SynchronousSolve=True)  # -> Worksheet, SelectedLabels, SelectedData, Format
panel_2 = Panel(hops_4.SelectedLabels)
